# Dynamo graph CollectionInDynamo.dyn (Dynamo 2.5.0.7460)

family_types = FamilyTypes("Area Tag:Area Tag")
all_elements_of_family_type = ElementsOfFamilyType(Family_Type=family_types)

# group: Category -->
categories = Categories("OST_Walls")
all_elements_of_category = ElementsOfCategory(Category=categories)

get_family_parameter = FamilyInstanceParameters(f=categories)  # nothing selected
byRuleType = Revit.Filter.FilterRule.ByRuleType(type=all_elements_of_category)  # unwired: value, parameter

# group: Element Types (avail. in doc, not all actually placed)
element_types = ElementTypes("Wall")
all_elements_of_type = ElementsOfType(element_type=element_types)
element_types_2 = ElementTypes("WallType")
all_elements_of_type_2 = ElementsOfType(element_type=element_types_2)

family_types_2 = FamilyTypes()  # nothing selected

# group: Family Type
code_block = CodeBlock { "Family"; }
getParameterValueByName = Element.GetParameterValueByName(element=all_elements_of_category, parameterName=code_block)

# group: Family
code_block_2 = CodeBlock { "Family Name"; }
getParameterValueByName_2 = Element.GetParameterValueByName(element=getParameterValueByName, parameterName=code_block_2)
