# Dynamo graph DynamoPythonSetup.dyn (Dynamo 2.5.0.7460)

directory_path = Directory("No file selected.")
ZAxis = Vector.ZAxis()
python_script = Python(IN[0]=directory_path, IN[1]=ZAxis)
# ---------- python_script.python (78 lines) ----------
"""
Notes: yes, this looks scary but it makes development in dynamo easier!
"""

import traceback

# print list
printList = []

try:
	# standard modules
	import clr
	import math
	import os
	import re
	import sys	
	import System
	
	# search for python files in this repo's asset/py folder
	sys.path.append(IN[0])
	
	# RevitServices for Dynamo
	clr.AddReference("RevitServices")
	import RevitServices
	from RevitServices.Persistence import DocumentManager
	from RevitServices.Transactions import TransactionManager
	
	# Revit/Dynamo Nodes
	clr.AddReference("RevitNodes")
	import Revit
	clr.ImportExtensions(Revit.Elements)
	clr.ImportExtensions(Revit.GeometryConversion)
	
	# Dynamo Geometry nodes
	clr.AddReference("ProtoGeometry")
	from Autodesk.DesignScript.Geometry import *
	
	# Revit API
	clr.AddReference('RevitAPI')
	clr.AddReference('RevitAPIUI')
	import Autodesk # noqa E402
	from Autodesk.Revit.UI import * # noqa E402
	from Autodesk.Revit import DB # noqa E402
	import Autodesk.Revit.UI.Selection # noqa E402
	
	# dynamo document management
	doc = DocumentManager.Instance.CurrentDBDocument
	uiapp = DocumentManager.Instance.CurrentUIApplication
	app = uiapp.Application
	uidoc = DocumentManager.Instance.CurrentUIApplication.ActiveUIDocument
	
	user = str(System.Environment.UserName)
	tol = 0.001
	
	# transaction variables
	tStart = TransactionManager.Instance.EnsureInTransaction(doc)
	tEnd = TransactionManager.Instance.TransactionTaskDone()


	#===================================================================
	# inputs
	nodeInput = IN[0]
	
	
	# code goes here
	printList.append("Hello")
	printList.append(nodeInpt)
	
	
	#===================================================================
	# outputs | OUT[-1] should always be print statements
	OUT = ["code output", printList]
	#===================================================================
	

except:
	# print traceback in order to debug file | OUT[-1] should always be print statements
	OUT = ["Code Failed: {0}".format(traceback.format_exc()), printList]
# ----------------------------------------
code_block = CodeBlock(OUT=python_script) { OUT[0]; OUT[1]; }
watch = Watch(code_block.out0)
print_statements = Watch(code_block.out1)
